# Grasshopper definition HU2.ghx (Grasshopper 1.0.8)
# Copyright: 2024
# plug-ins: RhinoCodePluginGH, V-Ray For Grasshopper 8

# ----
# HU2
number_slider = Slider(24, range=0..100)
number_slider_2 = Slider(14, range=0..100)
number_slider_3 = Slider(0.38, range=0..1)

galapagos = Galapagos(fitness=volume, gene=number_slider_3)
range = Range(Domain=Domain(0, 1), Steps=number_slider_2)
graph = GraphMapper(range, x0=0, x1=1, y0=0, y1=1, container_name="Bezier", cpx=[0, 0.25, 0.75, 1], cpy=[0, 0.25, 0.75, 1])
graph_2 = GraphMapper(range, x0=0, x1=1, y0=0, y1=1, container_name="Bezier", cpx=[0, 0.282954812, 0.6886360645, 1], cpy=[0, 0, 1, 1])
X = UnitX(Factor=1)

crv = Curve(<curve referenced from the Rhino model>)
end = EndPoints(Curve=crv)  # -> Start, End
item = ListItem(List=end.End, Index=0, Wrap=True)
pdecon = Deconstruct(Point=item)  # -> XComponent, YComponent, ZComponent

length_start = Slider(85, range=0..100)
length_width_end = Slider(15, range=0..100)
width_start = Slider(25, range=0..100)
dom = ConstructDomain(DomainStart=length_start, DomainEnd=length_width_end)
dom_2 = ConstructDomain(DomainStart=width_start, DomainEnd=length_width_end)
range_2 = Range(Domain=Domain(1, 0), Steps=number_slider_2)
range_3 = Range(Domain=Domain(1, 0), Steps=number_slider_2)
graph_3 = GraphMapper(range_2, x0=0, x1=1, y0=0, y1=1, container_name="Bezier", cpx=[0, 0.25, 0.75, 1], cpy=[0, 0.25, 0.75, 1])
graph_4 = GraphMapper(range_3, x0=0, x1=1, y0=0, y1=1, container_name="Bezier", cpx=[0, 0.25, 0.75, 1], cpy=[0, 0.25, 0.75, 1])
remap = RemapNumbers(Value=graph_3, Source=Domain(1, 0), Target=dom)  # -> expr("x/2", Mapped), Clipped
remap_2 = RemapNumbers(Value=graph_4, Source=Domain(1, 0), Target=dom_2)  # -> Mapped, Clipped

remap_3 = RemapNumbers(Value=Slider(0, range=0..1), Source=Domain(0, 1), Target=number_slider_2)  # -> Mapped, Clipped
range_max_position = CSharpScript(steps=number_slider_2, maxPosition=remap_3.Mapped)  # -> R; inputs steps: Int32, maxPosition: Int32
# ---------- range_max_position: C# ----------
// Grasshopper Script Instance
#region Usings
using System;
using System.Linq;
using System.Collections;
using System.Collections.Generic;
using System.Drawing;

using Rhino;
using Rhino.Geometry;

using Grasshopper;
using Grasshopper.Kernel;
using Grasshopper.Kernel.Data;
using Grasshopper.Kernel.Types;
#endregion

public class Script_Instance : GH_ScriptInstance
{
    #region Notes
    /* 
      Members:
        RhinoDoc RhinoDocument
        GH_Document GrasshopperDocument
        IGH_Component Component
        int Iteration

      Methods (Virtual & overridable):
        Print(string text)
        Print(string format, params object[] args)
        Reflect(object obj)
        Reflect(object obj, string method_name)
    */
    #endregion

    private void RunScript(int steps, int maxPosition, ref object R)
    {
            
        if (maxPosition == null){
            maxPosition = steps;
        }

        float[] floatRange = GenerateFloatRange(steps, maxPosition);
        
        // Print the resulting array
        R = floatRange;


        static float[] GenerateFloatRange(int steps, int maxPosition)
        {
            steps++;
            
            if (maxPosition < 0 || maxPosition >= steps)
            {
                throw new ArgumentException("maxPosition should be between 0 and steps - 1");
            }

            // Create arrays for the two parts: before and after the maximum
            float[] rangeBeforeMax = Linspace(0, 1, maxPosition + 1);
            float[] rangeAfterMax = Linspace(1, 0, steps - maxPosition);

            // Concatenate them into a single array
            float[] result = new float[steps];
            Array.Copy(rangeBeforeMax, 0, result, 0, maxPosition);
            Array.Copy(rangeAfterMax, 0, result, maxPosition, steps - maxPosition);

            return result;
        }

        static float[] Linspace(float start, float end, int num)
        {
            float[] result = new float[num];
            float step = (end - start) / (num - 1);

            for (int i = 0; i < num; i++)
            {
                result[i] = start + step * i;
            }

            return result;
        }
    }
}
# ---------- end range_max_position ----------
graph_5 = GraphMapper(range_max_position, x0=0, x1=1, y0=0, y1=1, container_name="Bezier", cpx=[0, 0.25, 0.75, 1], cpy=[0, 0.25, 0.75, 1])

chamfer_start = Slider(7.83, range=0..100)
chamfer_end = Slider(4.5, range=0..100)
dom_3 = ConstructDomain(DomainStart=chamfer_start, DomainEnd=chamfer_end)
range_4 = Range(Domain=dom_3, Steps=number_slider_2)

inner_convexity = Slider(17.49, range=0..100)
range_5 = Range(Domain=Domain(1, 0), Steps=number_slider_2)
graph_6 = GraphMapper(range_5, x0=0, x1=1, y0=0, y1=1, container_name="Gaussian", factor=0.3271082044, mean=0.6906322241, sdev=0.1327042878)
dom_4 = ConstructDomain(DomainStart=inner_convexity, DomainEnd=0)
remap_4 = RemapNumbers(Value=graph_6, Source=Domain(1, 0), Target=dom_4)  # -> Mapped, Clipped

toggle = BooleanToggle(True)

bend = Slider(12, range=0..100)
x_segements = Slider(4, range=1..100)
y_segements = Slider(2, range=1..10)

parabola = Python3Script(N=x_segements, D="1", Inv="1")  # -> R; inputs N: Int32, D: Int32, Inv: Boolean
#   port N: Number of steps
#   port D: 0 = (0 To 1) 1 = (-1 To 1)
# ---------- parabola: Python ----------
if not N:
    N = 10

types = [(0, 1),
         (-1, 1)]
R = []
start, end = types[D]
diff = end - start
step = diff / N
N += 1
for i in range(N):
    f = (start + i * step) ** 2
    if Inv:
        R.append(end - f)
    else:
        R.append(f)
# ---------- end parabola ----------
range_6 = Range(Domain=Domain(0, 1), Steps=x_segements)
graph_7 = GraphMapper(range_6, x0=0, x1=1, y0=0, y1=1, container_name="Gaussian", factor=0.4075372815, mean=0.472511977, sdev=0.165032953)

panel = Panel(graph_5)

# ---- group: HU2
data = Data(Tree({0;0}: [Plane(origin=(101, 0, 0), x=(1, 0, 0), y=(0, 0.9804661629, 0.1966878324)), Plane(origin=(101, -1.447780466, 8.363830626), x=(1, 0, 0), y=(0, 0.9895312097, 0.144319039)), Plane(origin=(101, -3.074681583, 27.61901513), x=(1, 0, 0), y=(0, 0.9997177919, 0.02375576809)), Plane(origin=(101, -1.802444844, 51.88351619), x=(1, 0, 0), y=(0, 0.9917518842, -0.1281725406)), Plane(origin=(101, 3.455695827, 76.76827431), x=(1, 0, 0), y=(0, 0.9588288739, -0.2839844901)), Plane(origin=(101, 11.6948858, 98.58912421), x=(1, 0, 0), y=(0, 0.9072404981, -0.4206122663)), Plane(origin=(101, 20.02738753, 114.2253652), x=(1, 0, 0), y=(0, 0.8550678657, -0.5185160991)), Plane(origin=(101, 24, 120.4474378), x=(1, 0, 0), y=(0, 0.8301939855, -0.5574746151))], {0;1}: [27.4853217, 39.40552541, 42.98121591, 32.54782695, 21.67760053, 13.26796705, 8.752987241, 7.323962904], {0;2}: [25, 23.57142857, 22.14285714, 20.71428571, 19.28571429, 17.85714286, 16.42857143, 15], {0;3}: [3], {0;4}: [2], {0;5}: [10.52], {0;6}: ["1", "0.857143", "0.714286", "0.571429", "0.428571", "0.285714", "0.142857", "0"], {0;7}: [5.04, 4.891428571, 4.742857143, 4.594285714, 4.445714286, 4.297142857, 4.148571429, 4], {0;8}: [0.07329835393, 1.380404542, 8.158841859, 15.13424043, 8.810543928, 1.609736496, 0.09230321716, 0.001661073554], {0;9}: [0.009540885584, 0.5822379757, 0.6009944359, 0.01049297062]))

# ----
toggle_2 = BooleanToggle(True)
neg = Negative(Value=Slider(4.58, range=0..10))
pt = Point(Point(-26.98561534, 7.256085748, 73.15168578))
pt_2 = Point(Point(-0.01004993339, 29.15199374, 95.62397189))
pt_3 = Point(Point(31.14821915, 9.294656673, 82.06305256))
pt_4 = Point(Point(36.3962441, 8.965399033, 74.57749443))
pt_5 = Point(Point(36.3962441, 8.965399033, 74.57749443))
merge = Merge(Data1=pt_3, Data2=pt_4, Data3=pt_5)
neg_2 = Negative(Value=Slider(3.743, range=0..10))
height = Slider(3, range=0..10)
radius = Slider(1.5, range=0..10)
gap = Slider(0.7, range=0..10)
timeline = VRayTimeline(FramesCount=30)  # -> Timeline, CurrentFrame, CurrentFraction

# ---- group: Switch input type
dispatch = Dispatch(List=Slider(113, range=0..1000), DispatchPattern=invert(toggle))  # -> ListA, ListB
dispatch_2 = Dispatch(List=remap.Mapped, DispatchPattern=invert(toggle))  # -> ListA, ListB
dispatch_3 = Dispatch(List=pdecon.ZComponent, DispatchPattern=toggle)  # -> ListA, ListB
merge_2 = Merge(Data1=dispatch_3.ListA, Data2=dispatch.ListA)

# ----
c_script = CSharpScript(y=number_slider, z=merge_2, Mt=Slider(0.428, range=0..1), T=Slider(12.117, range=0..100), t=graph)  # -> A, F; inputs x: Double, y: Double, z: Double, Mt: Double, T: Double, t: list of Double
# ---------- c_script: C# ----------
// Grasshopper Script Instance
#region Usings
using System;
using System.Linq;
using System.Collections;
using System.Collections.Generic;
using System.Drawing;

using Rhino;
using Rhino.Geometry;

using Grasshopper;
using Grasshopper.Kernel;
using Grasshopper.Kernel.Data;
using Grasshopper.Kernel.Types;
#endregion

public class Script_Instance : GH_ScriptInstance
{
    #region Notes
    /* 
      Members:
        RhinoDoc RhinoDocument
        GH_Document GrasshopperDocument
        IGH_Component Component
        int Iteration

      Methods (Virtual & overridable):
        Print(string text)
        Print(string format, params object[] args)
        Reflect(object obj)
        Reflect(object obj, string method_name)
    */
    #endregion

    private void RunScript(
	double x,
	double y,
	double z,
	double Mt,
	double T,
	List<double> t,
	ref object A,
	ref object F)
    {
        Point3d pt1 = Point3d.Origin;
        Point3d pt2 = new Point3d(0, y, z);
        Line ln = new Line(pt1, pt2);
        Point3d mid = ln.PointAt(Mt);
        Vector3d vec = new Vector3d(0, -T, 0);
        mid += vec;
        Arc arc = new Arc(pt1, mid, pt2);
        A = arc;
        
        List<Plane> frame = new List<Plane>();
        Curve crv = arc.ToNurbsCurve();
        Interval intv = new Interval(0, 1);
        crv.Domain = intv;
        foreach (var item in t)
        {
            Plane pl = new Plane(crv.PointAt(item), crv.TangentAt(item));
            frame.Add(pl);
        }
        F = frame;

    }
}
# ---------- end c_script ----------
pframe = PerpFrame(Curve=reparameterize(c_script.A), Parameter=number_slider_3)
align = AlignPlane(Plane=c_script.F, Direction=X)  # -> Plane, Angle
cluster = Cluster(C=crv, P=align.Plane)

# ---- group: Switch input type (continued)
dispatch_4 = Dispatch(List=cluster, DispatchPattern=toggle)  # -> ListA, ListB
entwine = Entwine(Branch00=dispatch_4.ListA, Branch01=dispatch_2.ListA, FlattenInputs=True)
clean = CleanTree(RemoveNulls=True, RemoveInvalid=True, RemoveEmpty=True, Tree=entwine)

# ----
entwine_2 = Entwine(
    Branch00=align.Plane,
    Branch01=clean,
    Branch02=remap_2.Mapped,
    Branch03=x_segements,
    Branch04=y_segements,
    Branch05=bend,
    Branch06=panel,
    Branch07=range_4,
    Branch08=remap_4.Mapped,
    Branch09=graph_7,
    FlattenInputs=True)
data_2 = Data(entwine_2)
bang = ExplodeTree(Data=entwine_2)  # -> Branch0, Branch1, Branch2, Branch3, Branch4, Branch5, Branch6, Branch7, Branch8, Branch9

hu_profile_polylines = CSharpScript(
    P=bang.Branch0,
    LR=bang.Branch1,
    WR=bang.Branch2,
    XS=bang.Branch3,
    YS=bang.Branch4,
    B=bang.Branch5,
    BG=bang.Branch6,
    Ch=bang.Branch7)  # -> Pln, O1, O2, S1, S2; inputs P: list of Plane, LR: list of Double, WR: list of Double, XS: Int32, YS: Int32, B: Double, BG: list of Double, Ch: list of Double
# ---------- hu_profile_polylines: C# ----------
// Grasshopper Script Instance
#region Usings
using System;
using System.Linq;
using System.Collections;
using System.Collections.Generic;
using System.Drawing;

using Rhino;
using Rhino.Geometry;

using Grasshopper;
using Grasshopper.Kernel;
using Grasshopper.Kernel.Data;
using Grasshopper.Kernel.Types;
#endregion

public class Script_Instance : GH_ScriptInstance
{
    #region Notes
    /* 
      Members:
        RhinoDoc RhinoDocument
        GH_Document GrasshopperDocument
        IGH_Component Component
        int Iteration

      Methods (Virtual & overridable):
        Print(string text)
        Print(string format, params object[] args)
        Reflect(object obj)
        Reflect(object obj, string method_name)
    */
    #endregion

    private void RunScript(
	List<Plane> P,
	List<double> LR,
	List<double> WR,
	int XS,
	int YS,
	double B,
	List<double> BG,
	List<double> Ch,
	ref object Pln,
	ref object O1,
	ref object O2,
	ref object S1,
	ref object S2)
    {
        // Generated collections
        List<Polyline> plns = new List<Polyline>();
        List<object> offset1 = new List<object>();
        List<object> offset2 = new List<object>();
        List<object> side1 = new List<object>();
        List<object> side2 = new List<object>();

        // Remap input numbers
        List<double> bgRemap = Utility.RemapList(BG, 0, B);

        // Calculate parabolic graph map --> Bend
        double[] para = Utility.Parabola(XS, true, true);
        for (int i = 0; i < para.Length; i++)
        {
            para[i] = -(1 - para[i]);
        }

        // Main loop ----------------------------------------------------------
        for (int i = 0; i < P.Count; i++)
        {
            // Calculations
            Point3d p1 = P[i].Origin + new Vector3d(-LR[i], 0, 0);
            Point3d p2 = P[i].Origin + new Vector3d(LR[i], 0, 0);
            double dist = p2.DistanceTo(p1);
            double div = dist / XS;
            
            Polyline pln = new Polyline();
            
            // Inner loop: Generate Polylines ------
            for (int j = 0; j <= XS; j++)
            {
                var pt = new Point3d(p1.X + (j * div), p1.Y, p1.Z);
                var vec = P[i].YAxis * bgRemap[i] * -para[j];
                pln.Add(pt + vec);
            } 
            // -------------------------------------


            var crv = pln.ToPolylineCurve();
            var off1 = crv.Offset(P[i], WR[i] / 2, 0.001, CurveOffsetCornerStyle.Sharp);
            var offSh1 = off1[0].Trim(CurveEnd.Both, Ch[i]); //Shrink for chamfer
            var off2 = crv.Offset(P[i], -WR[i] / 2, 0.001, CurveOffsetCornerStyle.Sharp);
            var offSh2 = off2[0].Trim(CurveEnd.Both, Ch[i]); //Shrink for chamfer
            
            var ln1 = new Line(off1[0].PointAtStart, off2[0].PointAtStart).ToNurbsCurve();
            var lnSh1 = ln1.Trim(CurveEnd.Both, Ch[i]); //Shrink for chamfer
            var ln2 = new Line(off1[0].PointAtEnd, off2[0].PointAtEnd).ToNurbsCurve();
            var lnSh2 = ln2.Trim(CurveEnd.Both, Ch[i]); //Shrink for chamfer

            



            
            // Add results
            offset1.Add(offSh1);
            offset2.Add(offSh2);
            side1.Add(lnSh1);
            side2.Add(lnSh2);
            plns.Add(pln);
            

        }
        // ---------------------------------------------------------------------
        
        Pln = plns;
        O1 = offset1;
        O2 = offset2;
        S1 = side1;
        S2 = side2;
        


        
    }


    public class Utility
    {
        public static List<double> RemapList(List<double> values, double newMin, double newMax)
        {
            if (values == null || values.Count == 0)
            {
                throw new ArgumentException("The list of values cannot be null or empty.");
            }

            // Find the original minimum and maximum values of the list
            double oldMin = values.Min();
            double oldMax = values.Max();

            // Check if the list has a constant value
            if (oldMin == oldMax)
            {
                return values.Select(_ => (newMin + newMax) / 2).ToList();
            }

            // Remap each value from the old domain [oldMin, oldMax] to the new domain [newMin, newMax]
            return values.Select(value => Remap(value, oldMin, oldMax, newMin, newMax)).ToList();
        }

        private static double Remap(double value, double oldMin, double oldMax, double newMin, double newMax)
        {
            return newMin + (value - oldMin) * (newMax - newMin) / (oldMax - oldMin);
        }

        public static double[] Parabola(int segments, bool type, bool invert)
        {
            double[] dom = {0, 1};
            if (type){
                dom[0] = -1;
                dom[1] = 1;
            }

            double step = (dom[1]-dom[0]) / segments;
            double[] result = new double[segments+1];

            for (int i = 0; i <= segments; i++)
            {
                double f = Math.Pow((dom[0] + i * step), 2);
                if (invert){
                    result[i] = (dom[1] - f);
                }
                else {
                    result[i] = f;
                }
            }
            return result;
        }


    }
}
# ---------- end hu_profile_polylines ----------
deplane = DeconstructPlane(Plane=bang.Branch0)  # -> Origin, XAxis, YAxis, ZAxis
multiplication = Multiplication(A=bang.Branch9, B=graft(bang.Branch8))
multiplication_2 = Multiplication(A=graft(deplane.YAxis), B=multiplication)
divide = DivideCurve(Curve=hu_profile_polylines.O2, Count=bang.Branch3, Kinks=False)  # -> reverse(Points), Tangents, Parameters
divide_2 = DivideCurve(Curve=hu_profile_polylines.O1, Count=bang.Branch3, Kinks=False)  # -> Points, Tangents, Parameters
divide_3 = DivideCurve(Curve=hu_profile_polylines.S2, Count=bang.Branch4, Kinks=False)  # -> Points, Tangents, Parameters
divide_4 = DivideCurve(Curve=hu_profile_polylines.S1, Count=bang.Branch4, Kinks=False)  # -> reverse(Points), Tangents, Parameters
group = Group(Objects=divide_4.Points)
group_2 = Group(Objects=divide_2.Points)
group_3 = Group(Objects=divide_3.Points)

# ---- group: Inner Convexity
move = Move(Geometry=divide.Points, Motion=multiplication_2)  # -> Geometry, Transform

# ----
group_4 = Group(Objects=move.Geometry)
weave = Weave(Pattern=[0, 1, 2, 3], Stream0=group, Stream1=group_2, Stream2=group_3, Stream3=group_4, NullGaps=False)
ungroup = Ungroup(Group=weave)
pshift = ShiftPaths(Data=ungroup, Offset=-1)  # -> simplify(Data)

pline = PolyLine(Vertices=pshift, Closed=True)  # -> flatten(Polyline)
loft_mesh = Python3Script(S=pline)  # -> M; inputs S: list of Curve; same code as loft_mesh
tstat = TreeStatistics(Tree=weave)  # -> Paths, Length, Count
item_2 = ListItem(List=tstat.Paths, Index=0, Wrap=True)  # -> Item1, Item
branch = TreeBranch(Tree=weave, Path=item_2.Item, MaintainPaths=True)
branch_2 = TreeBranch(Tree=weave, Path=item_2.Item1, MaintainPaths=True)
ungroup_2 = Ungroup(Group=branch_2)
ungroup_3 = Ungroup(Group=branch)
cluster_2 = Cluster_6(pts=ungroup_2)
cluster_3 = Cluster_5(pts=ungroup_3)
cluster_4 = Cluster_7(M=cluster_3, D=Slider(7.18, range=0..10), descay=Slider(0.584, range=0..1))
cluster_5 = Cluster_7(M=cluster_2, D=neg, descay=Slider(0.868, range=0..1))
panel_2 = Panel(cluster_5)
c_script_2 = CSharpScript(M=cluster_5, T=Slider(0.14, range=0..1))  # -> mesh; inputs M: Mesh, T: Double
# ---------- c_script_2: C# ----------
// Grasshopper Script Instance
#region Usings
using System;
using System.Linq;
using System.Collections;
using System.Collections.Generic;
using System.Drawing;

using Rhino;
using Rhino.Geometry;

using Grasshopper;
using Grasshopper.Kernel;
using Grasshopper.Kernel.Data;
using Grasshopper.Kernel.Types;
#endregion

public class Script_Instance : GH_ScriptInstance
{
    private void RunScript(Mesh M, double T, ref object mesh)
    {
        // Write your logic here
        M.MergeAllCoplanarFaces(T);
        M.Vertices.CullUnused();
        M.Compact();
        M.Weld(Math.PI);
        mesh = M;
    }
}
# ---------- end c_script_2 ----------
mesh_join = CSharpScript(M=flatten([cluster_5, loft_mesh, cluster_4]))  # -> Mesh; inputs M: list of Mesh
# ---------- mesh_join: C# ----------
// Grasshopper Script Instance
#region Usings
using System;
using System.Linq;
using System.Collections;
using System.Collections.Generic;
using System.Drawing;

using Rhino;
using Rhino.Geometry;

using Grasshopper;
using Grasshopper.Kernel;
using Grasshopper.Kernel.Data;
using Grasshopper.Kernel.Types;
#endregion

public class Script_Instance : GH_ScriptInstance
{
    #region Notes
    /* 
      Members:
        RhinoDoc RhinoDocument
        GH_Document GrasshopperDocument
        IGH_Component Component
        int Iteration

      Methods (Virtual & overridable):
        Print(string text)
        Print(string format, params object[] args)
        Reflect(object obj)
        Reflect(object obj, string method_name)
    */
    #endregion

    private void RunScript(List<Mesh> M, ref object Mesh)
    {
        // Write your logic here
        Mesh m = new Mesh();
        foreach (var item in M)
        {
            m.Append(item);
        }
        m.Compact();
        m.Weld(Math.PI);
        m.UnifyNormals();
        Mesh = m;
    }
}
# ---------- end mesh_join ----------
c_script_3 = CSharpScript(M=cluster_5)  # -> mesh; inputs M: Mesh
# ---------- c_script_3: C# ----------
// Grasshopper Script Instance
#region Usings
using System;
using System.Linq;
using System.Collections;
using System.Collections.Generic;
using System.Drawing;

using Rhino;
using Rhino.Geometry;

using Grasshopper;
using Grasshopper.Kernel;
using Grasshopper.Kernel.Data;
using Grasshopper.Kernel.Types;
#endregion

public class Script_Instance : GH_ScriptInstance
{
    private void RunScript(Mesh M, ref object mesh)
    {
        // Write your logic here
        var mm = M;
        var unwrap = new MeshUnwrapper(mm);
        unwrap.SymmetryPlane = new Plane(new Point3d(0,0,0), new Vector3d(0,0,1));
        unwrap.Unwrap(MeshUnwrapMethod.LSCM);
        mesh = mm;
    }
}
# ---------- end c_script_3 ----------
demesh = DeconstructMesh(Mesh=c_script_2)  # -> Vertices, Faces, Colours, Normals
c_script_4 = CSharpScript(M=cluster_5, T=Slider(0.013, range=0..1))  # -> mesh; inputs M: Mesh, T: Double
# ---------- c_script_4: C# ----------
using System;
using System.Linq;
using System.Collections;
using System.Collections.Generic;
using System.Drawing;

using Rhino;
using Rhino.Geometry;

using Grasshopper;
using Grasshopper.Kernel;
using Grasshopper.Kernel.Data;
using Grasshopper.Kernel.Types;

public class Script_Instance : GH_ScriptInstance
{
    private void RunScript(Mesh M, double T, ref object mesh)
    {
        // Tolerance angle in radians for checking coplanarity
        double tolerance = T;

        // Ensure normals are calculated
        M.Normals.ComputeNormals();
        M.FaceNormals.ComputeFaceNormals();

        // Create a new mesh for the merged result
        Mesh mergedMesh = new Mesh();

        // Keep track of which faces have been processed
        bool[] processedFaces = new bool[M.Faces.Count];
        List<int> faceGroup = new List<int>();

        for (int i = 0; i < M.Faces.Count; i++)
        {
            if (processedFaces[i]) continue;

            // Start a new group of coplanar faces
            faceGroup.Clear();
            faceGroup.Add(i);
            processedFaces[i] = true;

            // Get the normal of the current face
            Vector3d referenceNormal = M.FaceNormals[i];

            // Check adjacent faces for coplanarity
            for (int j = 0; j < M.Faces.Count; j++)
            {
                if (i == j || processedFaces[j]) continue;

                Vector3d currentNormal = M.FaceNormals[j];

                // Check if normals are within tolerance
                if (Math.Abs(Vector3d.VectorAngle(referenceNormal, currentNormal)) < tolerance)
                {
                    faceGroup.Add(j);
                    processedFaces[j] = true;
                }
            }

            // Merge the vertices of the face group into a new polygon
            List<Point3d> vertices = new List<Point3d>();
            foreach (int faceIndex in faceGroup)
            {
                MeshFace face = M.Faces[faceIndex];
                
                // Add each vertex of the face to the list
                vertices.Add(M.Vertices[face.A]);
                vertices.Add(M.Vertices[face.B]);
                vertices.Add(M.Vertices[face.C]);
                
                if (face.IsQuad)
                {
                    vertices.Add(M.Vertices[face.D]);
                }
            }

            // Remove duplicates from the vertex list
            Point3d[] uniqueVertices = Point3d.CullDuplicates(vertices, Rhino.RhinoDoc.ActiveDoc.ModelAbsoluteTolerance);

            // Create a new face for the merged vertices
            if (uniqueVertices.Length >= 3)
            {
                // Create a planar face from the merged vertices
                MeshFace newFace;
                if (uniqueVertices.Length == 3)
                {
                    newFace = new MeshFace(mergedMesh.Vertices.Count, mergedMesh.Vertices.Count + 1, mergedMesh.Vertices.Count + 2);
                }
                else if (uniqueVertices.Length == 4)
                {
                    newFace = new MeshFace(mergedMesh.Vertices.Count, mergedMesh.Vertices.Count + 1, mergedMesh.Vertices.Count + 2, mergedMesh.Vertices.Count + 3);
                }
                else
                {
                    // If the number of vertices is more than 4, triangulate manually or handle complex polygons
                    continue;
                }

                // Add vertices to the new mesh
                foreach (Point3d vertex in uniqueVertices)
                {
                    mergedMesh.Vertices.Add(vertex);
                }

                // Add the new face to the mesh
                mergedMesh.Faces.AddFace(newFace);
            }
        }

        // Clean up and output the merged mesh
        mergedMesh.Vertices.CullUnused();
        mergedMesh.Compact();
        mesh = mergedMesh;
    }
}
# ---------- end c_script_4 ----------
panel_3 = Panel(c_script_4)
push_pull_mesh = CSharpScript(M=mesh_join, P=merge, N=Slider(4, range=0..10), x=neg_2)  # -> Mesh, a; inputs M: Mesh, P: list of Point3d, N: list of Int32, x: list of Double
# ---------- push_pull_mesh: C# ----------
// Grasshopper Script Instance
#region Usings
using System;
using System.Text.RegularExpressions;
using System.Linq;
using System.Collections;
using System.Collections.Generic;
using System.Drawing;

using Rhino;
using Rhino.Geometry;
using Rhino.Geometry.Collections;

using Grasshopper;
using Grasshopper.Kernel;
using Grasshopper.Kernel.Data;
using Grasshopper.Kernel.Types;
#endregion

public class Script_Instance : GH_ScriptInstance
{
    private void RunScript(
	Mesh M,
	List<Point3d> P,
	List<int> N,
	List<double> x,
	ref object Mesh,
	ref object a)
    {
        Mesh patch = new();
        Mesh mm = M;
        int n1 = P.Count - N.Count;
        int n2 = P.Count - x.Count;
        
        // Longest list solution
        if (N.Count < P.Count) {
            for (int i = 0; i < n1; i++) {
                N.Add(N[N.Count-1]);
            }
        }
        if (x.Count < P.Count) {
            for (int i = 0; i < n2; i++) {
                x.Add(x[x.Count-1]);
            }
        }

        // Iterate on every point
        for (int l = 0; l < P.Count; l++)
        {
            // Get mesh vertices and faces list
            var faces = mm.Faces;
            var vertices = mm.Vertices;

            List<object> center = new(); // face centroid points

            // Calculate distances and face centroids
            SortedList distList = new();
            for (int i = 0; i < faces.Count; i++)
            {
                Point3d cen = faces.GetFaceCenter(i);

                center.Add(cen);
                double dist = P[l].DistanceTo(cen);
                
                distList.Add(dist, faces[i]);
                
            }
            
            // Get closest faces
            string[] closestFaces = new string[N[l]];
            string[] restFaces = new string[distList.Count - N[l]];
            for (int i = 0; i < distList.Count; i++) {
                if (i < N[l]) {
                    closestFaces[i] = (distList.GetByIndex(i).ToString());
                }
                else {
                    restFaces[i-N[l]] = (distList.GetByIndex(i).ToString());
                }
                
            }

            // Construct patch mesh
            Mesh patchMesh = ConstructMesh(vertices, closestFaces);
            patch = patchMesh;

            // Construct cut hole mesh
            Mesh cutHoleMesh = ConstructMesh(vertices, restFaces);


            //----------------------------------------------
            var newVertices = patchMesh.TopologyVertices;
            var movedVertices = patchMesh.Vertices;
            var newNormals = patchMesh.Normals; 
            
            float[] dists = new float[newVertices.Count];
            for (int i = 0; i < newVertices.Count; i++) {
                dists[i] = (float) P[l].DistanceTo(newVertices[i]);
            }
            
            float max = dists.Max();
            float min = dists.Min();
            float diff = max - min;

            for (int i = 0; i < newVertices.Count; i++) {
                if (newVertices.ConnectedEdgesCount(i) > 3) {
                    float t = (max - dists[i]) / diff * (float) x[l]; 
                    newVertices[i] += newNormals[i] * t;
                    movedVertices[i] = newVertices[i];
                }
            }
            //-------------------------------------------------

            cutHoleMesh.Append(patchMesh);
            cutHoleMesh.Weld(Math.PI);
            cutHoleMesh.UnifyNormals();
            mm = cutHoleMesh;
        }

        Mesh = mm;
        a = patch;
        
    }


    static Mesh ConstructMesh(MeshVertexList V, string[] F)
    {  
        
        Mesh mesh = new Mesh();

        // Add vertices to the mesh
        foreach (var pt in V)
        {
            mesh.Vertices.Add(pt);
        }

        // Add faces to the mesh
        foreach (var faceStr in F)
        {
            string cleanFaceStr = Regex.Replace(faceStr, @"[\s\)\()]", string.Empty);
            cleanFaceStr = cleanFaceStr.Substring(1, cleanFaceStr.Length-1);
            
            string[] indices = cleanFaceStr.Split(',');
            if (indices.Length == 4) // Assuming quad faces
            {
                int v0 = int.Parse(indices[0]);
                int v1 = int.Parse(indices[1]);
                int v2 = int.Parse(indices[2]);
                int v3 = int.Parse(indices[3]);

                mesh.Faces.AddFace(v0, v1, v2, v3);
            }
            else if (indices.Length == 3) // Handle triangular faces if needed
            {
                int v0 = int.Parse(indices[0]);
                int v1 = int.Parse(indices[1]);
                int v2 = int.Parse(indices[2]);

                mesh.Faces.AddFace(v0, v1, v2);
            }
        }

        mesh.Normals.ComputeNormals();
        mesh.Compact();
        
        return mesh;
    }
}
# ---------- end push_pull_mesh ----------
dam = DataDam(DataA=push_pull_mesh.Mesh, BufferDelay=10000000, BufferMode=0)
subdmesh = SubDFromMesh(Mesh=dam, Creases=1, Corners=1, Interpolate=False)

bbox = BoundingBox(Content=subdmesh, Plane=pframe)  # -> Box, Box_2
edges = BrepEdges(Brep=bbox.Box)  # -> Naked, Interior, NonManifold
volume = Volume(Geometry=bbox.Box)  # -> Volume, Centroid
py3 = Python3Script(B=bbox.Box)  # -> pts, U, V, W; inputs B: Box
# ---------- py3: Python ----------
import Rhino.Geometry as rg
pts = B.GetCorners()
U = B.X[1] - B.X[0]
V = B.Y[1] - B.Y[0]
W = B.Z[1] - B.Z[0]
# ---------- end py3 ----------
panel_4 = Panel(volume.Volume)
item_3 = ListItem(List=py3.pts, Index=0, Wrap=True)  # -> Item, Item1, Item2, Item3, Item4
ln = Line(StartPoint=item_3.Item, EndPoint=item_3.Item1)
ln_2 = Line(StartPoint=item_3.Item, EndPoint=item_3.Item4)
ln_3 = Line(StartPoint=item_3.Item1, EndPoint=item_3.Item2)

subdpoly = SubDControlPolygon(SubD=subdmesh)
medges = MeshEdges(Mesh=subdpoly)  # -> NakedEdges, InteriorEdges, NonManifoldEdges

subdmesh_2 = SubDFromMesh(Mesh=push_pull_mesh.Mesh, Creases=1, Corners=1, Interpolate=False)

cluster_6 = Cluster_2(L=pshift, S=Slider(2, range=0..10), D=Slider(8, range=0..30), ex=Slider(4, range=0..10))
c_script_5 = CSharpScript(B=cluster_6)  # -> S; inputs B: Brep
# ---------- c_script_5: C# ----------
// Grasshopper Script Instance
#region Usings
using System;
using System.Linq;
using System.Collections;
using System.Collections.Generic;
using System.Drawing;

using Rhino;
using Rhino.Geometry;

using Grasshopper;
using Grasshopper.Kernel;
using Grasshopper.Kernel.Data;
using Grasshopper.Kernel.Types;
#endregion

public class Script_Instance : GH_ScriptInstance
{
    #region Notes
    /* 
      Members:
        RhinoDoc RhinoDocument
        GH_Document GrasshopperDocument
        IGH_Component Component
        int Iteration

      Methods (Virtual & overridable):
        Print(string text)
        Print(string format, params object[] args)
        Reflect(object obj)
        Reflect(object obj, string method_name)
    */
    #endregion

    private void RunScript(Brep B, ref object S)
    {
        for (int i = 0; i < B.Surfaces.Count; i++) {
            bool a = B.Faces[i].ShrinkSurfaceToEdge();
            Console.WriteLine(a);
        }

        S = B;
      
    }
}
# ---------- end c_script_5 ----------

number_slider_4 = Slider(0.23, range=0..1)
subtraction = Subtraction(A=1, B=number_slider_4)
subtraction_2 = Subtraction(A=1, B=Slider(0.73, range=0..1))
dom_5 = ConstructDomain(DomainStart=number_slider_4, DomainEnd=subtraction)
dom_6 = ConstructDomain(DomainStart=Slider(0.08, range=0..1), DomainEnd=subtraction_2)
dom² = ConstructDomain²(DomainU=dom_5, DomainV=dom_6)
subsrf = Isotrim(Surface=reparameterize(c_script_5), Domain=dom²)

preview = CustomPreview(
    Geometry=subdmesh_2,
    Material={diffuse=RGB(221, 160, 221), emission=RGB(66, 48, 66), shine=0.5, specular=RGB(255, 255, 255), transparency=0})
dim = Dimensions(Surface=subsrf)  # -> UDimension, VDimension
panel_5 = Panel(dim.VDimension)
panel_6 = Panel(dim.UDimension)
cluster_7 = Cluster_3(S=subsrf, U=Slider(3, range=0..100), V=Slider(5, range=0..100), R=radius, H=height, G=gap)
geo = Geometry(flatten(cluster_7))
group_5 = Group(Geometry=cluster_7)  # -> flatten(Group)
reduce = RandomReduce(List=geo, Reduction=Slider(6, range=0..10), Seed=Slider(1, range=0..10))
group_6 = Group(Geometry=reduce)

subdedges = SubDEdges(SubD=subdmesh, NewFormatting=False)  # -> Line, Edge, Tag, Id
midpt = CurveMiddle(Curve=subdedges.Edge)
c_script_6 = CSharpScript(C=subdedges.Edge)  # -> G; inputs C: list of Curve
# ---------- c_script_6: C# ----------
// Grasshopper Script Instance
#region Usings
using System;
using System.Linq;
using System.Collections;
using System.Collections.Generic;
using System.Drawing;

using Rhino;
using Rhino.Geometry;

using Grasshopper;
using Grasshopper.Kernel;
using Grasshopper.Kernel.Data;
using Grasshopper.Kernel.Types;
#endregion

public class Script_Instance : GH_ScriptInstance
{
    #region Notes
    /* 
      Members:
        RhinoDoc RhinoDocument
        GH_Document GrasshopperDocument
        IGH_Component Component
        int Iteration

      Methods (Virtual & overridable):
        Print(string text)
        Print(string format, params object[] args)
        Reflect(object obj)
        Reflect(object obj, string method_name)
    */
    #endregion

    private void RunScript(List<Curve> C, ref object G)
    {
        // Write your logic here
        double t = this.RhinoDocument.ModelAbsoluteTolerance;
    int n = C.Count;
    Point3d[] PS = new Point3d[n];
    Point3d[] PE = new Point3d[n];
    Vector3d[] TS = new Vector3d[n];
    Vector3d[] TE = new Vector3d[n];
    bool[] uS = new bool[n];
    bool[] uE = new bool[n];
    int[] iS = new int[n];
    int[] iE = new int[n];
    bool[] used = new bool[n];
    for(int i = 0;i < n;i++){
      PS[i] = C[i].PointAtStart;
      PE[i] = C[i].PointAtEnd;
      TS[i] = C[i].TangentAtStart;
      TE[i] = C[i].TangentAtEnd;
      iS[i] = -1;
      iE[i] = -1;
      if(C[i].IsPeriodic){
        iS[i] = i;
        iE[i] = i;
      }
    }
    for(int i = 0;i < n;i++){
      for(int j = 0;j < n;j++){if(i != j){
          if(!uS[i] && !uS[j] && (PS[i].DistanceTo(PS[j]) < t) && (Math.Sin(Rhino.Geometry.Vector3d.VectorAngle(TS[i], TS[j])) < 0.001)){
            uS[i] = true; uS[j] = true; iS[i] = j; iS[j] = i;
          }
          if(!uS[i] && !uE[j] && (PS[i].DistanceTo(PE[j]) < t) && (Math.Sin(Rhino.Geometry.Vector3d.VectorAngle(TS[i], TE[j])) < 0.001)){
            uS[i] = true; uE[j] = true; iS[i] = j; iE[j] = i;
          }
          if(!uE[i] && !uS[j] && (PE[i].DistanceTo(PS[j]) < t) && (Math.Sin(Rhino.Geometry.Vector3d.VectorAngle(TE[i], TS[j])) < 0.001)){
            uE[i] = true; uS[j] = true; iE[i] = j; iS[j] = i;
          }
          if(!uE[i] && !uE[j] && (PE[i].DistanceTo(PE[j]) < t) && (Math.Sin(Rhino.Geometry.Vector3d.VectorAngle(TE[i], TE[j])) < 0.001)){
            uE[i] = true; uE[j] = true; iE[i] = j; iE[j] = i;
          }
        }}
    }
    Grasshopper.DataTree<int> tree = new Grasshopper.DataTree<int>();
    int loop = 0;
    int curr = 0;
    int old = -1;
    for(int i = 0;i < n;i++){
      curr = i;
      if(!used[curr]){
        tree.Add(curr, new GH_Path(loop));
        used[curr] = true;

        if(!uS[curr] && !uE[curr]){
          loop++;
          continue;
        }
        if(uE[curr]){
          for(int k = 0;k < 100;k++){
            if(uE[curr] && (iE[curr] != old) && (iE[curr] != i) && !used[iE[curr]]){
              old = curr;
              curr = iE[curr];
              tree.Add(curr, new GH_Path(loop));
              used[curr] = true;
            }else if(uS[curr] && (iS[curr] != old) && (iS[curr] != i) && !used[iS[curr]]){
              old = curr;
              curr = iS[curr];
              tree.Add(curr, new GH_Path(loop));
              used[curr] = true;
            }else{break;}
          }
        }
        old = -1;
        curr = i;
        if(uS[curr]){
          for(int k = 0;k < 100;k++){
            if(uE[curr] && (iE[curr] != old) && (iE[curr] != i) && !used[iE[curr]]){
              old = curr;
              curr = iE[curr];
              tree.Add(curr, new GH_Path(loop));
              used[curr] = true;
            }else if(uS[curr] && (iS[curr] != old) && (iS[curr] != i) && !used[iS[curr]]){
              old = curr;
              curr = iS[curr];
              tree.Add(curr, new GH_Path(loop));
              used[curr] = true;
            }else{break;}
          }
        }
        loop++;
      }
    }
    G = tree;
    }
}
# ---------- end c_script_6 ----------
points = PointList(Points=midpt)
c_script_7 = CSharpScript(T=c_script_6, i="121")  # -> B; inputs T: tree of Int32, i: Int32
# ---------- c_script_7: C# ----------
// Grasshopper Script Instance
#region Usings
using System;
using System.Linq;
using System.Collections;
using System.Collections.Generic;
using System.Drawing;

using Rhino;
using Rhino.Geometry;

using Grasshopper;
using Grasshopper.Kernel;
using Grasshopper.Kernel.Data;
using Grasshopper.Kernel.Types;
#endregion

public class Script_Instance : GH_ScriptInstance
{
    #region Notes
    /* 
      Members:
        RhinoDoc RhinoDocument
        GH_Document GrasshopperDocument
        IGH_Component Component
        int Iteration

      Methods (Virtual & overridable):
        Print(string text)
        Print(string format, params object[] args)
        Reflect(object obj)
        Reflect(object obj, string method_name)
    */
    #endregion

    private void RunScript(DataTree<int> T, int i, ref object B)
    {
        // Write your logic here
      for(int p = 0; p < T.BranchCount; p++){
      List<int> list = T.Branch(p);
      foreach(int a in list){
        if(a == i){B = list;break;}
      }
    }
    }
}
# ---------- end c_script_7 ----------
subd_to_nurbs = Python3Script(S=subdmesh, Ex=4)  # -> B; inputs S: SubD, Ex: Int32; same code as subd_to_nurbs
item_4 = ListItem(List=subdedges.Edge, Index=c_script_7, Wrap=True)
join = JoinCurves(Curves=item_4, Preserve=False)

preview_2 = CustomPreview(Geometry=edges.Interior, Material="white")
curve_preview = CustomCurvePreview(Curve=medges.InteriorEdges, Colour=RGB(0, 0, 0))
linedim = LineDimension(Line=[ln, ln_3, ln_2], Text="{0:0.00}", Size=Slider(2.25, range=0..10))

# ----
# Inside surface
panel_7 = Panel("1")
offset_mesh = Python3Script(M=dam, D=panel_7)  # -> M; inputs M: Mesh, D: Double, C: Boolean
# ---------- offset_mesh: Python ----------
"""Grasshopper Script Instance"""
import System
import Rhino
import Grasshopper

import rhinoscriptsyntax as rs
import Rhino.Geometry as rg

class MyComponent(Grasshopper.Kernel.GH_ScriptInstance):
    def RunScript(self, M: Rhino.Geometry.Mesh, D: float, C: bool):
        
        if not C:
            C = False
        
        mesh = M.Offset(D, C)

        return mesh
# ---------- end offset_mesh ----------
subdmesh_3 = SubDFromMesh(Mesh=offset_mesh, Creases=1, Corners=1, Interpolate=False)
number_slider_5 = Slider(1, range=0..10)
pipe = Pipe(Curve=join, Radius=number_slider_5, Caps=0)
split = SplitBrep(Brep=subd_to_nurbs, Cutter=pipe)
item_5 = ListItem(List=split, Index=0, Wrap=True)  # -> Item, Item1, Item2
Y = UnitY(Factor=Slider(29, range=0..100))

subdedges_2 = SubDEdges(SubD=subdmesh_3, NewFormatting=False)  # -> Line, Edge, Tag, Id
midpt_2 = CurveMiddle(Curve=subdedges_2.Edge)
c_script_8 = CSharpScript(C=subdedges_2.Edge)  # -> G; inputs C: list of Curve; same code as c_script_6
points_2 = PointList(Points=midpt_2)
subd_to_nurbs_2 = Python3Script(S=subdmesh_3, Ex=4)  # -> B; inputs S: SubD, Ex: Int32; same code as subd_to_nurbs
c_script_9 = CSharpScript(T=c_script_8, i="121")  # -> B; inputs T: tree of Int32, i: Int32; same code as c_script_7
item_6 = ListItem(List=subdedges_2.Edge, Index=c_script_9, Wrap=True)
join_2 = JoinCurves(Curves=item_6, Preserve=False)

pipe_2 = Pipe(Curve=join_2, Radius=number_slider_5, Caps=0)
split_2 = SplitBrep(Brep=subd_to_nurbs_2, Cutter=pipe_2)
item_7 = ListItem(List=split_2, Index=0, Wrap=True)  # -> Item, Item1, Item2
cluster_8 = Cluster_8(A=item_5.Item1, B=item_7.Item1)
cluster_9 = Cluster_8(A=item_5.Item2, B=item_7.Item2)
cluster_10 = Cluster_8(A=item_5.Item, B=item_7.Item)
join_3 = BrepJoin(Breps=flatten([item_5.Item1, item_7.Item1, cluster_8]))  # -> Breps, Closed
join_4 = BrepJoin(Breps=flatten([item_5.Item, item_7.Item, cluster_10]))  # -> Breps, Closed
join_5 = BrepJoin(Breps=flatten([item_5.Item2, item_7.Item2, cluster_9]))  # -> Breps, Closed
merge_3 = Merge(Data1=group_6, Data2=join_3.Breps)
merge_4 = Merge(Data1=group_6, Data2=join_4.Breps, Data3=join_3.Breps)
move_2 = Move(Geometry=merge_3, Motion=Y)  # -> Geometry, Transform
merge_5 = Merge(Data1=join_4.Breps, Data2=move_2.Geometry)
dispatch_5 = Dispatch(List=merge_5, DispatchPattern=invert(toggle_2))  # -> ListA, ListB
dispatch_6 = Dispatch(List=merge_4, DispatchPattern=toggle_2)  # -> ListA, ListB
group_7 = Group(Geometry=flatten([dispatch_5.ListA, dispatch_6.ListA]))
ungroup_4 = Ungroup(Group=group_7)
ungroup_5 = Ungroup(Group=ungroup_4)
ungroup_6 = Ungroup(Group=ungroup_5)  # -> flatten(Geometry)

preview_3 = CustomPreview(Geometry=flatten(group_7), Material=ColourSwatch(SwatchColor=RGB(194, 29, 29)))

preview_4 = CustomPreview(Geometry=flatten(join_5.Breps), Material=ColourSwatch(SwatchColor=RGBA(255, 255, 255, 82)))

swatch = ColourSwatch(SwatchColor=RGB(38, 38, 38))
mtl_simple = VRayMaterialSimple(
    Diffuse=swatch,
    Reflection={AColor2=[0.5372549295, 0.5372549295, 0.5372549295, 1], FileName="", Float=0, State=2},
    Glossiness=Slider(0.59, range=0..1),
    IOR=1.3,
    Opacity={AColor2=[0, 0, 0, 0], FileName="", Float=1, State=4},
    Emission={AColor2=[0, 0, 0, 1], FileName="", Float=0, State=2})
mtl_simple_2 = VRayMaterialSimple(
    Diffuse=ColourSwatch(SwatchColor=RGB(255, 255, 255)),
    Reflection={AColor2=[0.5372549295, 0.5372549295, 0.5372549295, 1], FileName="", Float=0, State=2},
    Glossiness=Slider(0.5, range=0..1),
    IOR=1.3,
    Opacity=Slider(0.27, range=0..1),
    Emission=ColourSwatch(SwatchColor=RGB(255, 255, 255)))
mtl_simple_3 = VRayMaterialSimple(
    Diffuse=ColourSwatch(SwatchColor=RGB(115, 4, 143)),
    Reflection={AColor2=[0.5372549295, 0.5372549295, 0.5372549295, 1], FileName="", Float=0, State=2},
    Glossiness=Slider(0.34, range=0..1),
    IOR=1.3,
    Opacity={AColor2=[0, 0, 0, 0], FileName="", Float=1, State=4},
    Emission={AColor2=[0, 0, 0, 1], FileName="", Float=0, State=2})
mesh = Mesh(flatten(join_5.Breps))
mesh_2 = Mesh(flatten(ungroup_6))
inf_plane = VRayInfinitePlane(Mtl=mtl_simple, ShadowCatcherOn=False, ZOffset=0, PositionFromGeometry=True)
position = Position(Point(165.5082557, 303.8420983, 144.7452347))
target = Target(Point(0.7936192167, -0.3831853534, 59.82206872))
camera = VRayCamera(
    Type=0,
    Stereo=0,
    Position=position,
    Target=target,
    FOV=27.1566906,
    Tilt=0,
    OrthographicZoomFactor=0,
    PhysicalExposureOn=False,
    WhiteBalance=RGB(255, 255, 255),
    FNumber=8,
    ShutterSpeed1S=100,
    FilmSensitivity=625,
    AutoExposure=False,
    AutoWhiteBalance=False,
    DepthOfFieldFocus=0)  # -> Camera, Angle, ExposureValue
sampler = Sampler(
    0,
    Has_Extract_Parameter=False,
    Has_Manage_Collection=False,
    OptionsLength=2,
    Version=1,
    Options=["Progressive", "Bucket"])
quality = Quality(
    3,
    Has_Extract_Parameter=False,
    Has_Manage_Collection=False,
    OptionsLength=6,
    Version=1,
    Options=["Low", "Low+", "Medium", "Medium+", "High", "High+"])
engine = Engine(0, Has_Extract_Parameter=False, Has_Manage_Collection=False, OptionsLength=3, Version=1, Options=["CPU", "CUDA", "RTX"])
mode = Mode(
    0,
    Has_Extract_Parameter=False,
    Has_Manage_Collection=False,
    OptionsLength=2,
    Version=1,
    Options=["Interactive", "Production"])
environment = VRayEnvironment(Background=swatch, GlobalIllumination=ColourSwatch(SwatchColor=RGB(255, 255, 255)))
dispatch_7 = Dispatch(List=camera.Camera, DispatchPattern=Toggle(True))  # -> ListA, ListB
light_dome = VRayDomeLight(
    On=True,
    Invisible=True,
    Texture={AColor2=[1, 1, 1, 1], FileName="", Float=0, State=2},
    Intensity=Slider(1.654, range=0..10),
    BasePlane=PlaneXY(0, 0, 0))
panel_8 = Panel("""960
960""")

weld = WeldMesh(Mesh=mesh, Angle=3.141592654)
light_mesh = VRayLightMesh(
    On=True,
    Texture={AColor2=[1, 1, 1, 1], FileName="", Float=0, State=2},
    Intensity=Slider(50, range=0..100),
    Invisible=False,
    Geometry=weld)
weld_2 = WeldMesh(Mesh=mesh_2, Angle=3.141592654)

vgeo = VRayGeometry(Geo=flatten(weld_2), Material=mtl_simple_3, Visible=True, quality=0)
vgeo_2 = VRayGeometry(Geo=flatten(weld), Material=mtl_simple_2, Visible=True, quality=0)
render = VRayRender(
    Engine=engine,
    Mode=mode,
    Sampler=sampler,
    Quality=quality,
    OutputResolution=panel_8,
    Camera=dispatch_7.ListA,
    Light=flatten([light_dome, light_mesh]),
    VGeometry=flatten([vgeo, vgeo_2, inf_plane]),
    Environment=environment,
    UpdateEffectsFrequency=100)

# ==== cluster Cluster
P = ClusterInput()
pdecon = Deconstruct(Point=P)  # -> XComponent, YComponent, ZComponent
C = ClusterInput()
pt = ConstructPoint(XCoordinate=pdecon.XComponent, YCoordinate=0, ZCoordinate=pdecon.ZComponent)
pcx = CurvePlane(Curve=C, Plane=pt)  # -> Points, ParamsC, ParamsP
pdecon_2 = Deconstruct(Point=pcx.ParamsP)  # -> flatten(XComponent), YComponent, ZComponent
X = ClusterOutput(pdecon_2.XComponent)

# ==== cluster Cluster_2
L = ClusterInput()
S = ClusterInput()
shift = ShiftList(List=L, Shift=S, Wrap=True)
D = ClusterInput()
subset = SubList(List=reverse(shift), Domain=D, Wrap=True)  # -> List, Index
pline = PolyLine(Vertices=subset.List, Closed=False)  # -> flatten(Polyline)
loft_mesh = Python3Script(S=pline)  # -> M; inputs S: list of Curve
# ---------- loft_mesh: Python ----------
"""Grasshopper Script Instance"""
import System
import Rhino
import Grasshopper

import Rhino.Geometry as rg
import rhinoscriptsyntax as rs
from math import ceil, pi
import ghpythonlib.components as gc


class MyComponent(Grasshopper.Kernel.GH_ScriptInstance):
    def RunScript(self, S: System.Collections.Generic.List[Rhino.Geometry.Curve]):
        
        M = rg.Mesh()
        for k in range(len(S)-1):

            pl1 = S[k].ToNurbsCurve().Points
            pts1 = []
            for j in range(pl1.Count):
                pts1.append(rg.Point3d(pl1[j].X, pl1[j].Y, pl1[j].Z))
            pl2 = S[k+1].ToNurbsCurve().Points
            pts2 = []
            for l in range(pl2.Count):
                pts2.append(rg.Point3d(pl2[l].X, pl2[l].Y, pl2[l].Z))   
            
            pts2.reverse()
            V = pts1 + pts2

            face_n = int((len(V)-2)/2)
            
            n = [i for i in range(len(V))]
            Faces = []
            for i in range(face_n):
                cb = '{}'
                ch = f'Q{cb[0]}{n[0]};{n[1]};{n[-2]};{n[-1]}{cb[1]}'
                Faces.append(ch)
                n.pop(-1)
                n.pop(0)
            
            mesh = gc.ConstructMesh(V, Faces)
            M.Append(mesh)
        M.Weld(pi)
        return M
# ---------- end loft_mesh ----------
flipm = FlipMesh(Mesh=loft_mesh, VertexNormals=True, FaceNormals=True, FaceOrientation=True)
subdmesh = SubDFromMesh(Mesh=flipm, Creases=1, Corners=1, Interpolate=False)
ex = ClusterInput()
subd_to_nurbs = Python3Script(S=subdmesh, Ex=ex)  # -> B; inputs S: SubD, Ex: Int32
#   port Ex: None = 0 LocalG1 = 1 LocalG2 = 2 LocalG1x = 3 LocalG1xx = 4
# ---------- subd_to_nurbs: Python ----------
import Rhino.Geometry as rg
if Ex > 4:
    raise ValueError('This option doesn\'nt exist. (0, 4)')
opt = rg.SubDToBrepOptions()
opt.PackFaces = True
evp = rg.SubDToBrepOptions.ExtraordinaryVertexProcessOption(Ex)
opt.ExtraordinaryVertexProcess = evp
B = S.ToBrep(opt)
# ---------- end subd_to_nurbs ----------
B = ClusterOutput(subd_to_nurbs)

# ==== cluster Cluster_3
S = ClusterInput()
R = ClusterInput()
H = ClusterInput()
G = ClusterInput()
U = ClusterInput()
V = ClusterInput()
sdivide = DivideSurface(Surface=S, UCount=U, VCount=V)  # -> Points, Normals, Parameters
flip = FlipMatrix(Data=sdivide.Points)
intcrv = Interpolate(Vertices=flip, Degree=3, Periodic=False, KnotStyle=1)  # -> Curve, Length, Domain
multiplication = Multiplication(A=R, B=2)
len = Length(Curve=intcrv.Curve)
addition = Addition(A=multiplication, B=G)
division = Division(A=len, B=addition)
int = Integer(division)
divide = DivideCurve(Curve=intcrv.Curve, Count=int, Kinks=False)  # -> Points, Tangents, Parameters
srf_cp = SurfaceClosestPoint(Point=divide.Points, Surface=S)  # -> Point, UVPoint, Distance
evalsrf = EvaluateSurface(Surface=S, Point=srf_cp.UVPoint)  # -> Point, Normal, UDirection, VDirection, Frame
sph = Sphere(Base=evalsrf.Point, Radius=R)
cir = Circle(Plane=evalsrf.Frame, Radius=R)
srfsplit = SurfaceSplit(Surface=graft(sph), Curves=graft(cir))
item = ListItem(List=srfsplit, Index=0, Wrap=True)
pshift = ShiftPaths(Data=item, Offset=-2)  # -> simplify(Data)
cyl = Cylinder(Base=evalsrf.Frame, Radius=R, Length=expr("-x", H))
scale_nu = ScaleNU(Geometry=pshift, Plane=simplify(evalsrf.Frame), ScaleX=1, ScaleY=1, ScaleZ=Slider(0.2, range=0..1))  # -> Geometry, Transform
weave = Weave(Pattern=[0, 1], Stream0=graft(cyl), Stream1=graft(scale_nu.Geometry), NullGaps=False)
join = BrepJoin(Breps=weave)  # -> Breps, Closed
pshift_2 = ShiftPaths(Data=join.Breps, Offset=-2)  # -> simplify(Data)
geometry = ClusterOutput(pshift_2)

# ==== cluster Cluster_5
pts = ClusterInput()
bang = ExplodeTree(Data=pts)  # -> _03000, _03001, _03002, _03003
pline = PolyLine(Vertices=flatten(pts), Closed=True)
pline_2 = PolyLine(Vertices=bang._03002, Closed=False)
lng = ListLength(List=bang._03002)
len = Length(Curve=pline_2)
group = Group(Geometry=reverse(bang._03000))  # -> flatten(Group)
group_2 = Group(Geometry=bang._03002)  # -> flatten(Group)
ln = Line(StartPoint=bang._03001, EndPoint=reverse(bang._03003))
len_2 = Length(Curve=ln)
expression = Expression(x=len_2, y=len, Expression="(x-y)/2")
py3 = Python3Script(C=ln, D=expression)  # -> Crv; inputs C: Curve, D: Double, E: Int32
# ---------- py3: Python ----------
"""Grasshopper Script Instance"""
import System
import Rhino
import Grasshopper

import rhinoscriptsyntax as rs
import Rhino.Geometry as rg

class MyComponent(Grasshopper.Kernel.GH_ScriptInstance):
    def RunScript(self, C: Rhino.Geometry.Curve, D: float, E: int):
        if not E:
            E = 3
        if not D:
            D = 0
        try:
            if D:
                Crv = C.Trim(rg.CurveEnd(E), D)
            else:
                Crv = C
        except:
            pass
        return Crv
# ---------- end py3 ----------
divide = DivideCurve(Curve=py3, Count=expr("x-1", lng), Kinks=False)  # -> Points, Tangents, Parameters
group_3 = Group(Geometry=divide.Points)  # -> flatten(Group)
ins = InsertItems(List=group_3, Item=[group, group_2], Indices=[0, -1], Wrap=True)
ungroup = Ungroup(Group=ins)
flip = FlipMatrix(Data=ungroup)
pline_3 = PolyLine(Vertices=flip, Closed=False)  # -> flatten(Polyline)
explode = Explode(Curve=pline, Recursive=True)  # -> Segments, Vertices
cluster = Cluster_4(ca=pline_3, cb=ln)
cluster_2 = Cluster_4(ca=ln, cb=pline_3)
merge = Merge(Data1=explode.Segments, Data2=cluster, Data3=cluster_2)  # -> flatten(Result)
c_script = CSharpScript(L=merge, T="0.01")  # -> M; inputs L: list of Curve, T: Double
# ---------- c_script: C# ----------
// Grasshopper Script Instance
#region Usings
using System;
using System.Linq;
using System.Collections;
using System.Collections.Generic;
using System.Drawing;

using Rhino;
using Rhino.Geometry;

using Grasshopper;
using Grasshopper.Kernel;
using Grasshopper.Kernel.Data;
using Grasshopper.Kernel.Types;
#endregion

public class Script_Instance : GH_ScriptInstance
{
    #region Notes
    /* 
      Members:
        RhinoDoc RhinoDocument
        GH_Document GrasshopperDocument
        IGH_Component Component
        int Iteration

      Methods (Virtual & overridable):
        Print(string text)
        Print(string format, params object[] args)
        Reflect(object obj)
        Reflect(object obj, string method_name)
    */
    #endregion

    private void RunScript(List<Curve> L, double T, ref object M)
    {

        // Convert L to an array
        Curve[] L_array = L.ToArray();

        // Pass the array to CreateFromLines
        Mesh mesh = Mesh.CreateFromLines(L_array, 4, T);

        M = mesh;
    }
}
# ---------- end c_script ----------
mesh = ClusterOutput(c_script)

# ==== cluster Cluster_6
pts = ClusterInput()
bang = ExplodeTree(Data=pts)  # -> _030140, _030141, _030142, _030143
pline = PolyLine(Vertices=flatten(pts), Closed=True)
pline_2 = PolyLine(Vertices=bang._030142, Closed=False)
lng = ListLength(List=bang._030142)
len = Length(Curve=pline_2)
group = Group(Geometry=reverse(bang._030140))  # -> flatten(Group)
group_2 = Group(Geometry=bang._030142)  # -> flatten(Group)
ln = Line(StartPoint=bang._030141, EndPoint=reverse(bang._030143))
len_2 = Length(Curve=ln)
expression = Expression(x=len_2, y=len, Expression="(x-y)/2")
py3 = Python3Script(C=ln, D=expression)  # -> Crv; inputs C: Curve, D: Double, E: Int32; same code as py3
divide = DivideCurve(Curve=py3, Count=expr("x-1", lng), Kinks=False)  # -> Points, Tangents, Parameters
group_3 = Group(Geometry=divide.Points)  # -> flatten(Group)
ins = InsertItems(List=group_3, Item=[group, group_2], Indices=[0, -1], Wrap=True)
ungroup = Ungroup(Group=ins)
flip = FlipMatrix(Data=ungroup)
pline_3 = PolyLine(Vertices=flip, Closed=False)  # -> flatten(Polyline)
explode = Explode(Curve=pline, Recursive=True)  # -> Segments, Vertices
cluster = Cluster_4(ca=pline_3, cb=ln)
cluster_2 = Cluster_4(ca=ln, cb=pline_3)
merge = Merge(Data1=explode.Segments, Data2=cluster, Data3=cluster_2)  # -> flatten(Result)
c_script = CSharpScript(L=merge, T="0.01")  # -> M; inputs L: list of Curve, T: Double; same code as c_script
mesh = ClusterOutput(c_script)

# ==== cluster Cluster_7
M = ClusterInput()
D = ClusterInput()
nv = NakedVertices(Mesh=M)  # -> ClothedIndex, NakedIndex, ClothedPts, NakedPts
demesh = DeconstructMesh(Mesh=M)  # -> Vertices, Faces, Colours, Normals
py3 = Python3Script(L=demesh.Vertices)  # -> N; inputs L: list
# ---------- py3: Python ----------
"""Grasshopper Script"""
import System
import Rhino
import Grasshopper

import rhinoscriptsyntax as rs

class MyComponent(Grasshopper.Kernel.GH_ScriptInstance):
    def RunScript(self, L: System.Collections.Generic.List[object]):
        a = int(len(L)/6)
        
        return a
# ---------- end py3 ----------
series = Series(Start=10, Step=5, Count=expr("x-2", py3))
descay = ClusterInput()
item = ListItem(List=demesh.Vertices, Index=nv.ClothedIndex, Wrap=True)
item_2 = ListItem(List=demesh.Vertices, Index=series, Wrap=True)
item_3 = ListItem(List=demesh.Normals, Index=nv.ClothedIndex, Wrap=True)
pline = PolyLine(Vertices=item_2, Closed=False)
dom = ConstructDomain(DomainStart=1, DomainEnd=descay)
crv_cp = CurveClosestPoint(Point=item, Curve=pline)  # -> Point, Parameter, Distance
bnd = Bounds(Numbers=crv_cp.Distance)
remap = RemapNumbers(Value=crv_cp.Distance, Source=bnd, Target=dom)  # -> Mapped, Clipped
multiplication = Multiplication(A=D, B=remap.Mapped)
amp = Amplitude(Vector=item_3, Amplitude=multiplication)
move = Move(Geometry=item, Motion=amp)  # -> Geometry, Transform
replace = ReplaceItems(List=demesh.Vertices, Item=move.Geometry, Indices=nv.ClothedIndex, Wrap=False)
conmesh = ConstructMesh(Vertices=replace, Faces=demesh.Faces)
mesh = ClusterOutput(conmesh)

# ==== cluster Cluster_8
A = ClusterInput()
B = ClusterInput()
edges = BrepEdges(Brep=A)  # -> Naked, Interior, NonManifold
edges_2 = BrepEdges(Brep=B)  # -> Naked, Interior, NonManifold
crv = Curve(edges.Naked)
crv_2 = Curve(edges_2.Naked)
join = JoinCurves(Curves=crv, Preserve=False)
join_2 = JoinCurves(Curves=crv_2, Preserve=False)
weave = Weave(Pattern=[0, 1], Stream0=graft(join), Stream1=graft(join_2), NullGaps=False)  # -> simplify(Weave)
loft = Loft(Curves=weave, Options={Adjust=False, Closed=False, LoftEnds=0, LoftSimp=0, LoftType=0, Rebuild=10, Refit=0.01})  # -> flatten(Loft)
surface = ClusterOutput(loft)

# ==== cluster Cluster_4
ca = ClusterInput()
cb = ClusterInput()
ccx = CurveCurve(CurveA=graft(ca), CurveB=cb)  # -> Points, ParamsA, ParamsB
pshift = ShiftPaths(Data=ccx.ParamsA, Offset=-1)
shatter = Shatter(Curve=graft(ca), Parameters=pshift)
curve = ClusterOutput(shatter)
